% Simulink data dictionary UAM_data.sldd

SensorAAFiltNum = 4386000
SensorAAFiltDen = [1 2960 4386000]

flightState = enum(DefaultValue="Hover")
  Hover = 0
  Transition = 1
  FixedWing = 2
  BackTransition = 3

FSState = flightState.Hover
R_WAYPOINTTRANSITION = 1
R_LOOKAHEAD = 5

AAC = Simulink.Bus()
  airspeed: double
  altitude: double
  course: double
  L1: double
  climbrate: double

HoverMission = struct(mode=uint8(0), position=[0; 0; 0], params=[0; 0; 0; 0])
UAVSampleTime = 0.02
TransitionMission = [struct(mode=1, position=[0; 0; 0], params=[0; 0; 0; 0]), struct(mode=2, position=[0; 0; -20], params=[0; 0; 0; 0]), struct(mode=2, position=[20; 0; -20], params=[0; 0; 0; 0]), struct(mode=6, position=[1; 1; 1], params=[1; 1; 1; 1]), struct(mode=2, position=[100; 0; -20], params=[0; 0; 0; 0]), struct(mode=3, position=[100; 200; -20], params=[50; -1; 0.5; 0]), struct(mode=6, position=[-1; -1; -1], params=[-1; -1; -1; -1]), struct(mode=2, position=[300; 300; -20], params=[0; 0; 0; 0]), struct(mode=4, position=[300; 300; 0], params=[0; 0; 0; 0])]
Vt = 10
zGround = 0

FixedWingCommandBus = Simulink.Bus()
  roll: double
  pitch: double
  yaw: double
  airspeed: double

HoverSPBus = Simulink.Bus()
  X: double
  Y: double
  Z: double
  Yaw: double

innerLoopCmdsBus = Simulink.Bus()
  LAP: double[3 1]
  HeadingCmd: double
  YawCmd: double

FlightModeType = enum(DefaultValue="Manual")
  Manual = 0
  Auto = 1
  Emergecny = 2

ReferenceFilterNum = 0.04877
ReferenceFilterDen = [1 -0.9512]

controlParams = struct(
  P_ROLL_RATE=2.589,
  D_ROLL_RATE=0.0166,
  N_ROLL_RATE=100,
  P_PITCH_RATE=4.4,
  D_PITCH_RATE=0.0217,
  N_PITCH_RATE=100,
  P_YAW_RATE=1.77,
  D_YAW_RATE=0,
  N_YAW_RATE=100,
  P_ROLL=8.79,
  P_PITCH=8.79,
  P_YAW=1,
  P_VX=1,
  D_VX=0,
  N_VX=1.0705,
  P_VY=0.2,
  D_VY=0.5518,
  N_VY=1.0705,
  P_VZ=5,
  D_VZ=0,
  N_VZ=8.4215,
  P_X=-0.5,
  P_Y=-1.03,
  P_Z=-1.97,
  P_BACK=0.1)

ControlSampleTime = 0.005

FixedWingCtrlBus = Simulink.Bus()
  dA: double
  dE: double
  dR: double
  dT: double

uavParam = struct(
  aero=struct(
    rho=1.225,
    CL0=0.8186,
    CLa=4.0913,
    CLa_dot=0,
    CLq=7.311,
    CLDe=0.5079,
    CLDa=-0.8529,
    CDmin=0.0605,
    K=0.1328,
    CL_CDmin=0.4806,
    A1=0,
    CdDe=0.016,
    CdDa=0.0921,
    CdDr=0.0097,
    Cm0=0.0076,
    Cma=-1.7697,
    Cmq=-19.2266,
    CmDe=-1.8375,
    CYb=-0.0016,
    CYp=-0.0016,
    CYr=0.1837,
    CYDr=0.1289,
    Clb=-0.0016,
    Clp=-0.4758,
    Clr=0.2715,
    ClDa=0.2866,
    ClDr=0.0134,
    Cnb=0.0918,
    Cnp=-0.1327,
    Cnr=-0.0883,
    CnDa=0.0049,
    CnDr=-0.067,
    dragCoeffMov=0.027,
    g=9.806),
  geom=struct(
    b=2,
    AR=7.2727,
    c=0.275,
    e=0.986,
    RotorArm1=[0.375 0.375 0],
    RotorArm2=[0.375 -0.375 0],
    RotorArm3=[-0.375 -0.375 0],
    RotorArm4=[-0.375 0.375 0],
    Ixx=0.267,
    Iyy=0.267,
    Izz=0.375,
    mass=6.023,
    PropDiameter=0.3052),
  motor=struct(RPMMAX=10000, tilt_trim=0))

w_trim = 110.3898
Cruise_a = 1
FWTrimSpeed = 166.667

RotorParameters = Simulink.Bus()
  w1: double
  w2: double
  w3: double
  w4: double
  c1: double

controlMode = Simulink.Bus()
  lateralGuidance: uint8
  airspeedAltitude: uint8
  attitude: uint8
  manual: uint8
  armed: uint8
  inTransition: uint8
  TransitionCondition: uint8
  BackTransitionCondition: uint8

RC = Simulink.Bus()
  roll: double
  pitch: double
  yaw: double
  throttle: double
  trigger: double

sensorData = Simulink.Bus()
  GPSCourse: double
  gndspeed: double
  DiffPress: double
  rho: double
  LLA: double[1 3]
  Abb: double[1 3]
  Gyro: double[1 3]
  Mag: double[1 3]
  GPSVelocity: double[1 3]
  Abe: double[1 3]
  RotorParameters: Bus: RotorParameters
  RC: Bus: RC

guidanceType = 3

StateBus = Simulink.Bus()
  course: double
  gndspeed: double
  airspeed: double
  Xe: double[3 1]
  Ve: double[3 1]
  DCMbe: double[3 3]
  q: double[1 4]
  pqr: double[3 1]
  Vb: double[1 3]
  Abb: double[1 3]
  Abe: double[1 3]
  Euler: double[3 1]
  RotorParameters: Bus: RotorParameters
  ypr: double[3 1]
  Ve_ground: double[3 1]

GuidanceStates = Simulink.Bus()
  Euler: double[3]
  pqr: double[3]
  Ve: double[3]
  Xe: double[3]
  course: double
  RotorParameters: Bus: RotorParameters

control = struct(
  turningRadius=60,
  L1=60,
  transitionRadius=60,
  minThrottle=0,
  maxThrottle=1,
  slewRateThrottle=1,
  slewRateServos=5,
  maxPitch=0.1745329,
  minPitch=-0.1745329,
  maxRoll=0.6981317,
  minRoll=-0.6981317,
  maxRollRate=1.22173,
  minRollRate=-1.22173,
  maxPitchRate=1.22173,
  minPitchRate=-1.22173,
  maxClimbRate=3,
  maxDescendRate=-3,
  stallSpeed=9.5,
  cruiseSpeed=20,
  takeoffSpeed=12.35,
  takeoffNavAlt=5,
  climboutAltMin=10,
  climboutAlt=13,
  landingApproachSpeed=12.35,
  flarePitch=0.03490659,
  flareAlt=2,
  landStopVel=1,
  finalLoiterSpeed=15)

FWControl = struct(transitionRadius=10)

FWControlParams = struct(
  P_CLIMBRATE=0.1,
  P_ALT=0.4,
  P_AIRSPD=10,
  I_AIRSPD=0,
  D_AIRSPD=0,
  N_AIRSPD=100,
  P_FW_ROLL=2,
  P_FW_PITCH=10,
  I_FW_PITCH=0,
  D_FW_PITCH=0,
  N_FW_PITCH=2.1893,
  P_FW_ROLLRATE=0.4,
  I_FW_ROLLRATE=0.8,
  P_FW_PITCHRATE=0.15,
  P_FW_YAWRATE=0.01)

RotorCtrlBus = Simulink.Bus()
  w1: double
  w2: double
  w3: double
  w4: double
  c1: double

plan = Simulink.Bus()
  mode: double
  ToWP: Bus: UAVPathManagerBus
  FromWP: Bus: UAVPathManagerBus

states = Simulink.Bus()
  pose: double[4 1]
  states: Bus: GuidanceStates
  ground: double

pose = Simulink.Bus()
  x: double
  y: double
  z: double
  yaw: double

UAVPathManagerBus = Simulink.Bus()
  mode: double
  position: double[3 1]
  params: double[4 1]